# Grasshopper definition Expressions.gh (Grasshopper 1.0.7)
# Copyright: 2020
# plug-ins: Anemone

# #02 - Increased Inclination with slope as slider
number_slider = Slider(-10, range=-10..10)
# #00 - 45 Degree Line
number_slider_2 = Slider(-10, range=-20..10)
# #01 - Reduced Inclination
number_slider_3 = Slider(-10, range=-10..10)
# #03 - Same Line intersecting at (0,10)
number_slider_4 = Slider(-10, range=-20..10)
# #07 - Making the Inverted Parabola Ample and intersecting with (0,5)
number_slider_5 = Slider(-20, range=-30..10)
# #05 - Drawing a Parabola
number_slider_6 = Slider(-10, range=-10..10)
# #08 - Cubic Curve
number_slider_7 = Slider(-2.1, range=-30..10)
# #04 - Negative Slope intersecting at (0, -10)
number_slider_8 = Slider(-10, range=-10..10)
# #06 - Inverting the Parabola
number_slider_9 = Slider(-10, range=-10..10)
# #09 - Absolute Value
number_slider_10 = Slider(-10, range=-10..10)
# #010 - The Sine Curve
panel = Panel("-4*Pi")
# #011 - The Cosine Curve
panel_2 = Panel("-4*Pi")
# #012 - The Tan Curve
panel_3 = Panel("-4*Pi")

# ----
# Starfish -2
amplitude = Slider(130, range=0..360)
number_slider_11 = Slider(1, range=0..10)
number_slider_12 = Slider(56, range=0..100)
series = Series(Start=number_slider_11, Step=number_slider_12, Count=amplitude)
series_2 = Series(Start=number_slider_11, Step=number_slider_12, Count=amplitude)
expression = Expression(x=series, r=series_2, Expression="r*cos(x)")
expression_2 = Expression(x=series, r=series_2, Expression="r*sin(x)")
panel_4 = Panel(series_2)
pt = ConstructPoint(XCoordinate=expression, YCoordinate=expression_2, ZCoordinate=0)

amplitude_2 = Slider(133, range=0..360)
number_slider_13 = Slider(1, range=0..10)
number_slider_14 = Slider(61, range=0..100)
series_3 = Series(Start=number_slider_13, Step=number_slider_14, Count=amplitude_2)
series_4 = Series(Start=number_slider_13, Step=number_slider_14, Count=amplitude_2)
expression_3 = Expression(x=series_3, r=series_4, Expression="r*cos(x)")
expression_4 = Expression(x=series_3, r=series_4, Expression="r*sin(x)")
panel_5 = Panel(series_4)
pt_2 = ConstructPoint(XCoordinate=expression_3, YCoordinate=expression_4, ZCoordinate=0)

# ----
# #013 - Juxtaposition of Sine and Slope
panel_6 = Panel("-4*Pi")

# ----
# Starfish -1
amplitude_3 = Slider(130, range=0..360)
number_slider_15 = Slider(1, range=0..10)
number_slider_16 = Slider(52, range=0..100)
series_5 = Series(Start=number_slider_15, Step=number_slider_16, Count=amplitude_3)
series_6 = Series(Start=number_slider_15, Step=number_slider_16, Count=amplitude_3)
panel_7 = Panel(series_6)
expression_5 = Expression(x=series_5, r=series_6, Expression="r*cos(x)")
expression_6 = Expression(x=series_5, r=series_6, Expression="r*sin(x)")
pt_3 = ConstructPoint(XCoordinate=expression_5, YCoordinate=expression_6, ZCoordinate=0)

number_slider_17 = Slider(6, range=0..10)
number_slider_18 = Slider(79, range=0..100)
amplitude_4 = Slider(360, range=0..360)
series_7 = Series(Start=number_slider, Step=Slider(1, range=0..10), Count=Slider(21, range=0..100))
amplitude_5 = Slider(4, range=0..100)
frequency = Slider(1, range=0..10)
dom = ConstructDomain(DomainStart=panel, DomainEnd="4*Pi")
dom_2 = ConstructDomain(DomainStart=panel_2, DomainEnd="4*Pi")
series_8 = Series(Start=number_slider_3, Step=Slider(1, range=0..10), Count=Slider(21, range=0..100))
series_9 = Series(Start=number_slider_2, Step=Slider(1, range=0..10), Count=Slider(21, range=0..100))
series_10 = Series(Start=Slider(-10, range=-10..10), Step=Slider(1, range=0..10), Count=Slider(21, range=0..100))
dom_3 = ConstructDomain(DomainStart=panel_3, DomainEnd="4*Pi")
series_11 = Series(Start=number_slider_5, Step=Slider(2, range=0..10), Count=Slider(21, range=0..100))
amplitude_6 = Slider(2, range=0..100)
frequency_2 = Slider(2, range=0..10)
# Adding Slope Control
slope_control = Slider(0.8, range=0..10)
# Increasing Slope
expression_7 = Expression(x=series_7, Expression="2*x")
series_12 = Series(Start=number_slider_7, Step=Slider(0.35, range=0..10), Count=Slider(13, range=0..100))
amplitude_7 = Slider(2, range=0..100)
frequency_3 = Slider(2, range=0..10)
series_13 = Series(Start=number_slider_4, Step=Slider(2, range=0..10), Count=Slider(21, range=0..100))
dom_4 = ConstructDomain(DomainStart=panel_6, DomainEnd="4*Pi")
series_14 = Series(Start=Slider(10, range=-10..10), Step=Slider(2, range=0..10), Count=Slider(21, range=0..100))
amplitude_8 = Slider(2, range=0..100)
frequency_4 = Slider(1, range=0..10)
expression_8 = Expression(x=series_8, Expression="0.5*x")
series_15 = Series(Start=number_slider_6, Step=Slider(1, range=0..10), Count=Slider(21, range=0..100))
# Making it "Fatter"
expression_9 = Expression(x=series_11, Expression="-x*0.115*x")
range = Range(Domain=dom, Steps=Slider(250, range=0..1000))
series_16 = Series(Start=number_slider_8, Step=Slider(2, range=0..10), Count=Slider(21, range=0..100))
series_17 = Series(Start=number_slider_9, Step=Slider(1, range=0..10), Count=Slider(21, range=0..100))
series_18 = Series(Start=number_slider_10, Step=Slider(1, range=0..10), Count=Slider(21, range=0..100))
series_19 = Series(Start=Slider(10, range=-10..10), Step=Slider(2, range=0..10), Count=Slider(21, range=0..100))
range_2 = Range(Domain=dom_2, Steps=Slider(250, range=0..1000))
dom_5 = ConstructDomain(DomainStart=Slider(0, range=0..100), DomainEnd=Slider(100, range=0..100))

# ----
# #014 - Experiment with various Expressions
number_slider_19 = Slider(500, range=0..5000)
amplitude_9 = Slider(14.282, range=0..100)
# Defining the X-Point
expression_10 = Expression(x=number_slider_19, Expression="x-1")
range_3 = Range(Domain=dom_5, Steps=expression_10)
expression_11 = Expression(x=range_3, y=range_3, a=amplitude_9, Expression="(a+0.5*y*cos(0.5*x))*cos(x)")

amplitude_10 = Slider(1.482, range=0..5)
expression_12 = Expression(x=Slider(500, range=0..5000), Expression="x-1")
# Defining the Y-Point
range_4 = Range(Domain=dom_5, Steps=expression_12)
expression_13 = Expression(x=range_4, y=range_4, a=amplitude_10, Expression="0.5*y*sin(0.5*x)*a")

range_5 = Range(Domain=dom_3, Steps=Slider(420, range=0..1000))
range_6 = Range(Domain=dom_4, Steps=Slider(93, range=0..1000))
expression_14 = Expression(x=series_12, Expression="x³")
expression_15 = Expression(x=series_19, Expression="-1*x")
expression_16 = Expression(x=series_15, Expression="x*x")
expression_17 = Expression(x=series_17, Expression="-x*x")
expression_18 = Expression(x=series_18, Expression="x*UnitX")
expression_19 = Expression(x=expression_7, y=slope_control, Expression="X*Y")
expression_20 = Expression(x=range, a=amplitude_6, f=frequency_2, Expression="a*sin(f*x)")
series_20 = Series(Start=number_slider_17, Step=number_slider_18, Count=amplitude_4)
series_21 = Series(Start=number_slider_17, Step=number_slider_18, Count=amplitude_4)
series_22 = Series(Start=number_slider_17, Step=number_slider_18, Count=amplitude_4)
expression_21 = Expression(x=range_2, a=amplitude_7, f=frequency_3, Expression="a*cos(f*x)")
series_23 = Series(Start=number_slider_17, Step=number_slider_18, Count=amplitude_4)
series_24 = Series(Start=number_slider_17, Step=number_slider_18, Count=amplitude_4)
series_25 = Series(Start=number_slider_17, Step=number_slider_18, Count=amplitude_4)
expression_22 = Expression(x=range_5, a=amplitude_8, f=frequency_4, Expression="a*tan(f*x)")
# Moving the Points to (0,5)
expression_23 = Expression(x=expression_9, Expression="x+30")
pt_4 = ConstructPoint(XCoordinate=series_9, YCoordinate=series_10, ZCoordinate=0)
expression_24 = Expression(x=range_6, a=amplitude_5, f=frequency, Expression="a*sin(f*x)+2*x")
pt_5 = ConstructPoint(XCoordinate=series_8, YCoordinate=expression_8, ZCoordinate=0)
pt_6 = ConstructPoint(XCoordinate=series_7, YCoordinate=expression_19, ZCoordinate=0)
pt_7 = ConstructPoint(XCoordinate=series_13, YCoordinate=series_14, ZCoordinate=0)
pt_8 = ConstructPoint(XCoordinate=series_16, YCoordinate=expression_15, ZCoordinate=0)
pt_9 = ConstructPoint(XCoordinate=series_15, YCoordinate=expression_16, ZCoordinate=0)
pt_10 = ConstructPoint(XCoordinate=series_17, YCoordinate=expression_17, ZCoordinate=0)
pt_11 = ConstructPoint(XCoordinate=series_18, YCoordinate=expression_18, ZCoordinate=0)
pt_12 = ConstructPoint(XCoordinate=series_12, YCoordinate=expression_14, ZCoordinate=0)
neg = Negative(Value=series_25)
expression_25 = Expression(x=series_20, r=series_21, Expression="r*cos(x)")
expression_26 = Expression(x=series_20, r=series_21, Expression="r*sin(x)")
expression_27 = Expression(x=series_23, r=series_24, Expression="r*cos(x)")
expression_28 = Expression(x=series_23, r=series_24, Expression="r*sin(x)")
pt_13 = ConstructPoint(XCoordinate=series_11, YCoordinate=expression_23, ZCoordinate=0)
preview = CustomPreview(Geometry=pt_4, Material=ColourSwatch(SwatchColor=RGB(0, 0, 0)))
pt_14 = ConstructPoint(XCoordinate=range, YCoordinate=expression_20, ZCoordinate=0)
pt_15 = ConstructPoint(XCoordinate=range_2, YCoordinate=expression_21, ZCoordinate=0)
preview_2 = CustomPreview(Geometry=pt_5, Material=ColourSwatch(SwatchColor=RGB(0, 0, 0)))
preview_3 = CustomPreview(Geometry=pt_7, Material=ColourSwatch(SwatchColor=RGB(0, 0, 0)))
preview_4 = CustomPreview(Geometry=pt_10, Material=ColourSwatch(SwatchColor=RGB(0, 0, 0)))
preview_5 = CustomPreview(Geometry=pt_6, Material=ColourSwatch(SwatchColor=RGB(0, 0, 0)))
preview_6 = CustomPreview(Geometry=pt_9, Material=ColourSwatch(SwatchColor=RGB(0, 0, 0)))
preview_7 = CustomPreview(Geometry=pt_8, Material=ColourSwatch(SwatchColor=RGB(0, 0, 0)))
pt_16 = ConstructPoint(XCoordinate=range_5, YCoordinate=expression_22, ZCoordinate=0)
preview_8 = CustomPreview(Geometry=pt_11, Material=ColourSwatch(SwatchColor=RGB(0, 0, 0)))
preview_9 = CustomPreview(Geometry=pt_12, Material=ColourSwatch(SwatchColor=RGB(0, 0, 0)))
preview_10 = CustomPreview(Geometry=pt_13, Material=ColourSwatch(SwatchColor=RGB(0, 0, 0)))
preview_11 = CustomPreview(Geometry=pt_14, Material=ColourSwatch(SwatchColor=RGB(0, 0, 0)))
pt_17 = ConstructPoint(XCoordinate=range_6, YCoordinate=expression_24, ZCoordinate=0)
preview_12 = CustomPreview(Geometry=pt_15, Material=ColourSwatch(SwatchColor=RGB(0, 0, 0)))

bnd = Bounds(Numbers=expression_28)
# Adding the Color Gradient
dedomain = DeconstructDomain(Domain=bnd)  # -> Start, End
gradient = Gradient(
    LowerLimit=dedomain.Start,
    UpperLimit=dedomain.End,
    Parameter=[expression_28, expression_26],
    stops=[0.109: RGB(255, 255, 255), 0.2: RGB(255, 128, 0), 0.3: RGB(255, 255, 255), 0.4: RGB(255, 255, 0), 0.5: RGB(255, 255, 255), 0.6: RGB(255, 128, 0), 0.7: RGB(255, 255, 255), 0.8: RGB(255, 255, 0), 0.9: RGB(255, 255, 255)])

bnd_2 = Bounds(Numbers=expression_13)
# Adding the Color Gradient
dedomain_2 = DeconstructDomain(Domain=bnd_2)  # -> Start, End
gradient_2 = Gradient(
    LowerLimit=dedomain_2.Start,
    UpperLimit=dedomain_2.End,
    Parameter=expression_13,
    stops=[0: RGB(0, 128, 0), 0.5: RGB(255, 255, 0), 1: RGB(255, 0, 0)])

preview_13 = CustomPreview(Geometry=pt_16, Material=ColourSwatch(SwatchColor=RGB(0, 0, 0)))
pt_18 = ConstructPoint(XCoordinate=expression_25, YCoordinate=expression_26, ZCoordinate=series_22)
pt_19 = ConstructPoint(XCoordinate=expression_27, YCoordinate=expression_28, ZCoordinate=neg)
intcrv = Interpolate(Vertices=pt_3, Degree=3, Periodic=False, KnotStyle=1)  # -> Curve, Length, Domain
intcrv_2 = Interpolate(Vertices=pt, Degree=3, Periodic=False, KnotStyle=1)  # -> Curve, Length, Domain
intcrv_3 = Interpolate(Vertices=pt_2, Degree=3, Periodic=False, KnotStyle=1)  # -> Curve, Length, Domain
preview_14 = CustomPreview(Geometry=pt_17, Material=ColourSwatch(SwatchColor=RGB(0, 0, 0)))
preview_15 = CustomPreview(Geometry=intcrv_2.Curve, Material=ColourSwatch(SwatchColor=RGB(99, 91, 91)))
pt_20 = ConstructPoint(XCoordinate=expression_11, YCoordinate=expression_13, ZCoordinate=0)
preview_16 = CustomPreview(Geometry=intcrv_3.Curve, Material=ColourSwatch(SwatchColor=RGB(122, 122, 122)))
intcrv_4 = Interpolate(Vertices=pt_20, Degree=3, Periodic=False, KnotStyle=1)  # -> Curve, Length, Domain
preview_17 = CustomPreview(Geometry=intcrv_4.Curve, Material=ColourSwatch(SwatchColor=RGB(0, 0, 0)))
preview_18 = CustomPreview(Geometry=[pt_18, pt_19], Material=gradient)
preview_19 = CustomPreview(Geometry=intcrv_4.Curve, Material=gradient_2)
number_slider_20 = Slider(100, range=0..100)  # disabled
number_slider_21 = Slider(100, range=0..100)  # disabled
number_slider_22 = Slider(6, range=1..10)
number_slider_23 = Slider(1, range=0..1)  # disabled
number_slider_24 = Slider(1, range=0..1)  # disabled
pop2d = Populate2D(Region={Plane=PlaneXY(0, 0, 0), Size=Domain2(u=0..20, v=0..10)}, Count=number_slider_20, Seed=1)  # disabled
# #20 - Spherical Sinusoid
number_slider_25 = Slider(-6, range=-100..100)

# ----
# YZ Plane
panel_8 = Panel("-4*Pi")
dom_6 = ConstructDomain(DomainStart=panel_8, DomainEnd="4*Pi")
amplitude_11 = Slider(2, range=0..100)
frequency_5 = Slider(2, range=0..10)
range_7 = Range(Domain=dom_6, Steps=Slider(250, range=0..1000))
expression_29 = Expression(x=range_7, a=amplitude_11, f=frequency_5, Expression="a*sin(f*x)")
pt_21 = ConstructPoint(XCoordinate=0, YCoordinate=range_7, ZCoordinate=expression_29)

# ----
# #15 - Moving towards YZ and XZ Planes
# XZ Plane
panel_9 = Panel("-4*Pi")
dom_7 = ConstructDomain(DomainStart=panel_9, DomainEnd="4*Pi")
amplitude_12 = Slider(2, range=0..100)
frequency_6 = Slider(2, range=0..10)
range_8 = Range(Domain=dom_7, Steps=Slider(250, range=0..1000))
expression_30 = Expression(x=range_8, a=amplitude_12, f=frequency_6, Expression="a*sin(f*x)")
pt_22 = ConstructPoint(XCoordinate=range_8, YCoordinate=0, ZCoordinate=expression_30)

# ----
# #19 - Spherical Spiral
panel_10 = Panel("0")

# ----
# Intersecting the Quadrants
panel_11 = Panel("-4*Pi")
dom_8 = ConstructDomain(DomainStart=panel_11, DomainEnd="4*Pi")
amplitude_13 = Slider(2, range=0..100)
frequency_7 = Slider(2, range=0..10)
range_9 = Range(Domain=dom_8, Steps=Slider(214, range=0..1000))
expression_31 = Expression(x=range_9, a=amplitude_13, f=frequency_7, Expression="a*sin(f*x)-0.5*x")
pt_23 = ConstructPoint(XCoordinate=0, YCoordinate=range_9, ZCoordinate=expression_31)

# ----
# #18 - Undulating Spiral
number_slider_26 = Slider(40, range=0..100)
number_slider_27 = Slider(-6, range=-100..100)
dom_9 = ConstructDomain(DomainStart="0", DomainEnd="Pi")
range_10 = Range(Domain=dom_9, Steps=number_slider_26)
expression_32 = Expression(x=range_10, y=number_slider_27, Expression="5*cos(2*y*x)*sin(x)")
expression_33 = Expression(x=range_10, y=number_slider_27, Expression="5*sin(y*2*x)*sin(x)")
expression_34 = Expression(x=range_10, Expression="5*cos(x)")
pt_24 = ConstructPoint(XCoordinate=expression_32, YCoordinate=expression_33, ZCoordinate=expression_34)
intcrv_5 = Interpolate(Vertices=pt_24, Degree=3, Periodic=False, KnotStyle=1)  # -> Curve, Length, Domain

# ----
# #17 - Conic Spiral
# Basic Conical Spiral
number_slider_28 = Slider(5, range=0..10)
number_slider_29 = Slider(6, range=0..100)
amplitude_14 = Slider(71, range=0..360)
# Method 1
number_slider_30 = Slider(5, range=0..10)
number_slider_31 = Slider(6, range=0..100)
amplitude_15 = Slider(71, range=0..360)
# Method 2
number_slider_32 = Slider(-71, range=-100..10)
number_slider_33 = Slider(1, range=0..10)
number_slider_34 = Slider(166, range=0..500)
frequency_8 = Slider(6, range=0..10)
# #16 - Plotting a Spiral in 3D
number_slider_35 = Slider(-10, range=-10..10)
pop2d_2 = Populate2D(Region={Plane=PlaneXY(0, 0, 0), Size=Domain2(u=0..20, v=0..10)}, Count=number_slider_21, Seed=1)  # disabled
number_slider_36 = Slider(1, range=0..1)  # disabled
number_slider_37 = Slider(20, range=0..25)  # disabled
# #21 - Experimenting with Motion
number_slider_38 = Slider(1, range=0..1)  # disabled
dom_10 = ConstructDomain(DomainStart=panel_10, DomainEnd="Pi")
expression_35 = Expression(x=number_slider_22, y="360", Expression="x*y")
expression_36 = Expression(x=number_slider_22, Expression="1/x")
number_slider_39 = Slider(20, range=0..100)  # disabled
lng = ListLength(List=pop2d)  # disabled
dom_11 = ConstructDomain(DomainStart=number_slider_23, DomainEnd=number_slider_24)  # disabled
amplitude_16 = Slider(10, range=0..10)
frequency_9 = Slider(6, range=0..10)
range_11 = Range(Domain=dom_10, Steps=Slider(40, range=0..100))
series_26 = Series(Start=0, Step=expression_36, Count=expression_35)
number_slider_40 = Slider(11, range=0..40)
series_27 = Series(Start=number_slider_32, Step=number_slider_33, Count=number_slider_34)
series_28 = Series(Start=number_slider_32, Step=number_slider_33, Count=number_slider_34)
series_29 = Series(Start=number_slider_32, Step=number_slider_33, Count=number_slider_34)
series_30 = Series(Start=number_slider_35, Step=Slider(1, range=0..10), Count=Slider(95, range=0..100))
rad = Radians(Degrees=series_26)
lng_2 = ListLength(List=pop2d_2)  # disabled
dom_12 = ConstructDomain(DomainStart=number_slider_38, DomainEnd=number_slider_36)  # disabled
series_31 = Series(Start=number_slider_28, Step=number_slider_29, Count=amplitude_14)
series_32 = Series(Start=number_slider_28, Step=number_slider_29, Count=amplitude_14)
series_33 = Series(Start=number_slider_28, Step=number_slider_29, Count=amplitude_14)
expression_37 = Expression(x=range_11, y=number_slider_25, Expression="5*cos(2*y*x)*sin(x)")
expression_38 = Expression(x=range_11, y=number_slider_25, Expression="5*sin(y*2*x)*sin(x)")
expression_39 = Expression(x=range_11, Expression="5*cos(x)")
k = Slider(0.47, range=0..1)
n = Slider(16, range=1..40)
series_34 = Series(Start=number_slider_30, Step=number_slider_31, Count=amplitude_15)
series_35 = Series(Start=number_slider_30, Step=number_slider_31, Count=amplitude_15)
series_36 = Series(Start=number_slider_30, Step=number_slider_31, Count=amplitude_15)
series_37 = Series(Start=number_slider_30, Step=number_slider_31, Count=amplitude_15)
series_38 = Series(Start=number_slider_30, Step=number_slider_31, Count=amplitude_15)
series_39 = Series(Start=number_slider_30, Step=number_slider_31, Count=amplitude_15)
random = Random(Range=dom_11, Number=lng, Seed=number_slider_39)  # disabled
vec = Vector(Vector(0, 0, 1))  # disabled
vec_2 = Vector(Vector(0, 0, 1))  # disabled
expression_40 = Expression(x=series_30, a=amplitude_16, f=frequency_9, Expression="a*sin(f*x)")
expression_41 = Expression(x=series_30, a=amplitude_16, f=frequency_9, Expression="a*cos(f*x)")
expression_42 = Expression(x=series_27, a=series_28, f=frequency_8, Expression="a*sin(f*x)")
expression_43 = Expression(x=series_27, a=series_28, f=frequency_8, Expression="a*cos(f*x)")
random_2 = Random(Range=dom_12, Number=lng_2, Seed=number_slider_37)  # disabled
expression_44 = Expression(x=series_31, r=series_32, Expression="r*cos(x)")
expression_45 = Expression(x=series_31, r=series_32, Expression="r*sin(x)")
neg_2 = Negative(Value=series_39)
number_slider_41 = Slider(100, range=0..1100)  # disabled
expression_46 = Expression(x=series_34, r=series_35, Expression="r*cos(x)")
expression_47 = Expression(x=series_34, r=series_35, Expression="r*sin(x)")
expression_48 = Expression(x=series_37, r=series_38, Expression="r*cos(x)")
expression_49 = Expression(x=series_37, r=series_38, Expression="r*sin(x)")
number_slider_42 = Slider(100, range=0..100)  # disabled
button = Button()  # disabled
eval = Evaluate(F="(Length(Force)/Mass)*Unitize(Force)", Force=vec, Mass=random)  # disabled
number_slider_43 = Slider(6, range=0..10)  # disabled
button_2 = Button()  # disabled
pt_25 = ConstructPoint(XCoordinate=expression_37, YCoordinate=expression_38, ZCoordinate=expression_39)
expression_50 = Expression(r=number_slider_40, x=rad, k=k, n=n, Expression="k*r*(cos(n*x)/(Sqrt(1+(k*cos(n*x))²)))")
sph = Sphere(Base=PlaneXY(0, 0, 0), Radius=number_slider_40)
eval_2 = Evaluate(F="(Length(Force)/Mass)*Unitize(Force)", Force=vec_2, Mass=random_2)  # disabled
expression_51 = Expression(r=number_slider_40, x=rad, k=k, n=n, Expression="r*(cos(x)/(Sqrt(1+(k*cos(n*x))²)))")
expression_52 = Expression(r=number_slider_40, x=rad, k=k, n=n, Expression="r*(sin(x)/(Sqrt(1+(k*cos(n*x))²)))")
pt_26 = ConstructPoint(XCoordinate=expression_42, YCoordinate=expression_43, ZCoordinate=series_29)
intcrv_6 = Interpolate(Vertices=pt_25, Degree=3, Periodic=False, KnotStyle=1)  # -> Curve, Length, Domain
pt_27 = ConstructPoint(XCoordinate=expression_44, YCoordinate=expression_45, ZCoordinate=series_33)
pt_28 = ConstructPoint(XCoordinate=series_30, YCoordinate=expression_40, ZCoordinate=expression_41)
loop_start = LoopStart(N=number_slider_41, T=button_2, D0=pop2d, D1=eval)  # -> port, Counter, Data, Data_2; disabled
pt_29 = ConstructPoint(XCoordinate=expression_46, YCoordinate=expression_47, ZCoordinate=series_36)
pt_30 = ConstructPoint(XCoordinate=expression_48, YCoordinate=expression_49, ZCoordinate=neg_2)
addition = Addition(A=number_slider_43, B=1)  # disabled
preview_20 = CustomPreview(Geometry=pt_28, Material=ColourSwatch(SwatchColor=RGB(0, 0, 0)))
loop_start_2 = LoopStart(N=number_slider_42, T=button, D0=pop2d_2, D1=eval_2)  # -> port, Counter, Data, Data_2; disabled
preview_21 = CustomPreview(Geometry=pt_23, Material=ColourSwatch(SwatchColor=RGB(0, 0, 0)))
preview_22 = CustomPreview(Geometry=pt_27, Material=ColourSwatch(SwatchColor=RGB(0, 0, 0)))
preview_23 = CustomPreview(Geometry=pt_26, Material=ColourSwatch(SwatchColor=RGB(0, 0, 0)))
number_slider_44 = Slider(6, range=0..10)  # disabled
number_slider_45 = Slider(1, range=0..1)  # disabled
preview_24 = CustomPreview(Geometry=[pt_29, pt_30], Material=ColourSwatch(SwatchColor=RGB(0, 0, 0)))
preview_25 = CustomPreview(Geometry=[intcrv_6.Curve, pt_25], Material=ColourSwatch(SwatchColor=RGB(0, 0, 0)))
cps = ClosestPoints(Point=graft(loop_start_2.Data), Cloud=loop_start_2.Data, Count=addition)  # -> ClosestPoint, CPIndex, Distance; disabled
pt_31 = ConstructPoint(XCoordinate=expression_51, YCoordinate=expression_52, ZCoordinate=expression_50)
intcrv_7 = Interpolate(Vertices=pt_31, Degree=3, Periodic=False, KnotStyle=1)  # -> Curve, Length, Domain
expression_53 = Expression(x=number_slider_44, y=number_slider_45, Expression="x+y")  # disabled
cps_2 = ClosestPoints(Point=graft(loop_start.Data), Cloud=loop_start.Data, Count=expression_53)  # -> ClosestPoint, CPIndex, Distance; disabled
cull_i = CullIndex(List=cps.ClosestPoint, Indices=1, Wrap=True)  # disabled
preview_26 = CustomPreview(Geometry=[intcrv_7.Curve, pt_31], Material=ColourSwatch(SwatchColor=RGB(0, 0, 0)))
number_slider_46 = Slider(0.8, range=0..1)  # disabled
vec2pt = Vector2Pt(PointA=graft(loop_start_2.Data), PointB=cull_i, Unitize=False)  # -> Vector, Length; disabled
cull_i_2 = CullIndex(List=cps_2.ClosestPoint, Indices=0, Wrap=True)  # disabled
repulsion = Slider(0.2, range=0..1)  # disabled
number_slider_47 = Slider(1, range=0..1)  # disabled
vec2pt_2 = Vector2Pt(PointA=graft(loop_start.Data), PointB=cull_i_2, Unitize=False)  # -> Vector, Length; disabled
attraction = Slider(0.2, range=0..1)  # disabled
unit = UnitVector(Vector=vec2pt.Vector)  # disabled
dist_threshold = Slider(6, range=0..10)  # disabled
expression_54 = Expression(x=vec2pt.Length, y=number_slider_46, Expression="x*y")  # disabled
expression_55 = Expression(x=vec2pt.Length, y=number_slider_46, Expression="x*y")  # disabled
expression_56 = Expression(x=repulsion, y=number_slider_47, Expression="x*y")  # disabled
move = Move(Geometry=loop_start_2.Data, Motion=Vector(0, 0, 10))  # -> Geometry, Transform; disabled
rev = Reverse(Vector=unit)  # disabled
expression_57 = Expression(x=attraction, y=number_slider_47, Expression="x*y")  # disabled
unit_2 = UnitVector(Vector=vec2pt_2.Vector)  # disabled
number_slider_48 = Slider(6, range=0..10)  # disabled
rev_2 = Reverse(Vector=unit_2)  # disabled
expression_58 = Expression(x=vec2pt_2.Length, y=dist_threshold, Expression="x<y")  # disabled
expression_59 = Expression(x=vec2pt_2.Length, y=dist_threshold, Expression="x>y")  # disabled
amp = Amplitude(Vector=rev, Amplitude=expression_55)  # disabled
amp_2 = Amplitude(Vector=unit, Amplitude=expression_54)  # disabled
amp_3 = Amplitude(Vector=rev_2, Amplitude=expression_56)  # disabled
amp_4 = Amplitude(Vector=unit_2, Amplitude=expression_57)  # disabled
cull = CullPattern(List=vec2pt_2.Vector, CullPattern=expression_59)  # disabled
smaller = SmallerThan(FirstNumber=vec2pt.Length, SecondNumber=number_slider_48)  # -> SmallerThan, OrEqualTo; disabled
larger = LargerThan(FirstNumber=vec2pt.Length, SecondNumber=number_slider_48)  # -> LargerThan, OrEqualTo; disabled
number_slider_49 = Slider(0.05, range=0..0.1)  # disabled
unit_3 = UnitVector(Vector=cull)  # disabled
p_n_c = PickNChoose(Pattern=expression_58, Stream0=amp_4, Stream1=amp_3)  # disabled
cull_2 = CullPattern(List=vec2pt.Vector, CullPattern=larger.LargerThan)  # disabled
number_slider_50 = Slider(0.05, range=0..0.1)  # disabled
amp_5 = Amplitude(Vector=unit_3, Amplitude=number_slider_49)  # disabled
p_n_c_2 = PickNChoose(Pattern=smaller.OrEqualTo, Stream0=amp, Stream1=amp_2)  # disabled
unit_4 = UnitVector(Vector=cull_2)  # disabled
number_slider_51 = Slider(0.01, range=0..0.01)  # disabled
ma = MassAddition(Input=[p_n_c, amp_5])  # -> flatten(Result), PartialResults; disabled
amp_6 = Amplitude(Vector=unit_4, Amplitude=number_slider_50)  # disabled
ma_2 = MassAddition(Input=[p_n_c_2, amp_6])  # -> flatten(Result), PartialResults; disabled
number_slider_52 = Slider(1, range=0..10)  # disabled
vlen = VectorLength(Vector=loop_start.Data_2)  # disabled
number_slider_53 = Slider(1, range=0..1)  # disabled
eval_3 = Evaluate(
    F="((Length(Force)/Mass)*Acceleration)*(Unitize(Force))",
    Force=ma_2.Result,
    Mass=random_2,
    Acceleration=number_slider_51)  # disabled
number_slider_54 = Slider(0.01, range=0..0.01)  # disabled
vlen_2 = VectorLength(Vector=loop_start_2.Data_2)  # disabled
expression_60 = Expression(x=vlen, y=number_slider_52, Expression="x*y")  # disabled
multiplication = Multiplication(A=vlen_2, B=number_slider_53)  # disabled
amp_7 = Amplitude(Vector=loop_start.Data_2, Amplitude=expression_60)  # disabled
amp_8 = Amplitude(Vector=loop_start_2.Data_2, Amplitude=multiplication)  # disabled
eval_4 = Evaluate(F="((Length(Force)/Mass)*Accel)*(Unitize(Force))", Force=ma.Result, Mass=random, Accel=number_slider_54)  # disabled
addition_2 = Addition(A=eval_3, B=amp_8)  # disabled
expression_61 = Expression(x=eval_4, y=amp_7, Expression="x+y")  # disabled
move_2 = Move(Geometry=loop_start.Data, Motion=expression_61)  # -> Geometry, Transform; disabled
loop_end = LoopEnd(
    port=loop_start_2.port,
    Exit=False,
    Data=move.Geometry,
    Data_2=addition_2,
    TimeOutVal=0,
    pausedState=False,
    state="Constant output")  # -> Data, D1; disabled
timer = Timer(TimerInterval=20, Target=loop_end_2)  # disabled
loop_end_2 = LoopEnd(
    port=loop_start.port,
    Exit=False,
    Data=move_2.Geometry,
    Data_2=expression_61,
    TimeOutVal=0,
    pausedState=False,
    state="Constant & Record")  # -> Data, D1; disabled
flip = FlipMatrix(Data=loop_end.Data)  # disabled
flip_2 = FlipMatrix(Data=loop_end_2.Data)  # disabled
intcrv_8 = Interpolate(Vertices=flip, Degree=3, Periodic=False, KnotStyle=1)  # -> Curve, Length, Domain; disabled

bnd_3 = Bounds(Numbers=flip_2)  # disabled
dedomain_3 = DeconstructDomain(Domain=bnd_3)  # -> Start, End; disabled
# Adding the Color Gradient
gradient_3 = Gradient(
    LowerLimit=dedomain_3.Start,
    UpperLimit=dedomain_3.End,
    Parameter=flip_2,
    stops=[0: RGB(0, 98, 0), 0.25: RGB(81, 175, 17), 0.5: RGB(159, 198, 146), 0.75: RGB(170, 235, 41), 1: RGB(221, 255, 53)])  # disabled

panel_12 = Panel(flip_2)  # disabled
intcrv_9 = Interpolate(Vertices=flip_2, Degree=3, Periodic=False, KnotStyle=1)  # -> flatten(Curve), Length, Domain; disabled
preview_27 = CustomPreview(Geometry=intcrv_9.Curve, Material=gradient_3)  # disabled
